# Grasshopper definition test.gh (Grasshopper 1.0.7)

number_slider = Slider(12, range=0..100)
number_slider_2 = Slider(304, range=0..1000)
number_slider_3 = Slider(3, range=0..10)
circle = Circle(Plane=PlaneXY(0, 0, 0), Radius=Slider(10, range=0..10))
unit_z = UnitZ(Factor=1)
pi = Pi(Factor="0.5")
divide_curve = DivideCurve(Curve=circle, Count=number_slider, Kinks=False)  # -> Points, Tangents, Parameters
random = Random(Range=Domain(0, 1), Number=number_slider, Seed=number_slider_2)
rotate = Rotate(Vector=divide_curve.Tangents, Axis=unit_z, Angle=pi)
construct_plane = ConstructPlane(Origin=divide_curve.Points, XAxis=divide_curve.Tangents, YAxis=rotate)
multiplication = Multiplication(A=random, B=number_slider_3)
multiplication_2 = Multiplication(A=random, B=Slider(20, range=0..100))
polygon = Polygon(Plane=construct_plane, Radius=3, Segments=6, FilletRadius=0)  # -> Polygon, Length
round = Round(Number=multiplication)  # -> Nearest, Floor, Ceiling
unit_z_2 = UnitZ(Factor=multiplication_2)
boundary_surfaces = BoundarySurfaces(Edges=polygon.Polygon)
division = Division(A=round.Floor, B=number_slider_3)
concatenate = Concatenate(FragmentA="Layer", FragmentB=round.Floor)
concatenate_2 = Concatenate(Fragment_A="test", Fragment_B=number_slider_2, A=".fbx")
extrude = Extrude(Base=boundary_surfaces, Direction=unit_z_2)
gradient = Gradient(
    LowerLimit=0,
    UpperLimit=1,
    Parameter=division,
    stops=[0: RGB(243, 57, 0), 0.1: RGB(236, 27, 60), 0.2: RGB(210, 0, 118), 0.3: RGB(103, 0, 120), 0.4: RGB(39, 72, 161), 0.5: RGB(1, 192, 229), 0.6: RGB(18, 178, 90), 0.7: RGB(79, 186, 8), 0.8: RGB(220, 237, 32), 0.9: RGB(247, 159, 20), 1: RGB(243, 57, 0)])
file_path = FilePath("/Users/jhorikawa/Desktop/files/")
c_script = CSharpScript(
    geos=flatten(extrude),
    layers=flatten(concatenate),
    colors=flatten(gradient),
    filedir=file_path,
    filename=concatenate_2,
    export=Toggle(False))  # -> out, A; inputs geos: list of GeometryBase, layers: list of String, colors: list of Color, filedir: String, filename: String, export: Boolean
# ---------- c_script: C# usings ----------
using System.IO;
# ---------- c_script: C# ----------
if(export){
    RhinoDoc doc = Rhino.RhinoDoc.ActiveDoc;
    var guids = new List<Guid>();

    for(int i=0; i<geos.Count; i++){
        var geo = geos[i];
        var layer = layers[i];
        var color = colors[i];

        var guid = Rhino.RhinoDoc.ActiveDoc.Objects.Add(geo);
        guids.Add(guid);

        var l = doc.Layers.FindName(layer);
        int layerid = -1;
        if(l == null){
            layerid = doc.Layers.Add(layer, color);
        }else{
            layerid = l.Index;
        }

        var robj = Rhino.RhinoDoc.ActiveDoc.Objects.Find(guid);
        robj.Attributes.LayerIndex = layerid;
        robj.CommitChanges();

    }


    doc.Objects.Select(guids);

    string filepath = Path.Combine(filedir, filename);

    string cmd = "_-Export " + "\"" + filepath + "\"" + " _Enter _Enter";

    Rhino.RhinoApp.RunScript(cmd, false);

    Rhino.RhinoDoc.ActiveDoc.Objects.Delete(guids, true);

    //doc.Views.Redraw();


}
# ---------- end c_script ----------
custom_preview = CustomPreview(Geometry=extrude, Material=gradient)
panel = Panel(c_script.out)
